# Grasshopper definition plurarch.gh (Grasshopper 1.0.8)

statepath = Panel("E:\Academic\PhD\Fall 2026\AI Workshop\PlurARCH\state\parameters.json")
plurarchtimer = Trigger(Interval=500, TimerInterval=500, Target=plurarchmodel)
plurarchmodel = Python3Script(path=statepath)  # -> out, geometry, colors, info, warning
# ---------- plurarchmodel: Python ----------
#! python3
# Plurarch loader: runs grasshopper/model_builder.py from the repo (recompiled only when the file
# changes). If the file cannot be read or has a typo, the last good version keeps running.
import os
import scriptcontext as sc
_MB = r"E:\Academic\PhD\Fall 2026\AI Workshop\PlurARCH\grasshopper\model_builder.py"
_key = "plurarch_loader_code"
_load_error = ""
_cached = sc.sticky.get(_key)
try:
    _mtime = os.path.getmtime(_MB)
    if not _cached or _cached[0] != _mtime:
        with open(_MB, encoding="utf-8") as _f:
            _cached = (_mtime, compile(_f.read(), _MB, "exec"))
        sc.sticky[_key] = _cached
except Exception as _e:
    _load_error = "model_builder.py could not be loaded (%s: %s); the last good version is running." % (
        type(_e).__name__, _e)
if _cached:
    exec(_cached[1])
if _load_error:
    try:
        warning = _load_error + ("\n" + warning if warning else "")
    except NameError:
        warning = _load_error
        geometry, colors, info = [], [], _load_error
# ---------- end plurarchmodel ----------
plurarchpreview = CustomPreview(Geometry=plurarchmodel.geometry, Material=plurarchmodel.colors)
info = Panel(plurarchmodel.info)
warning = Panel(plurarchmodel.warning)
